# Grasshopper definition smooth-turn-waypoints-example.gh (Grasshopper 1.0.8)
# plug-ins: Human, Whale

trigger = Trigger(Interval=100, TimerInterval=100, Target=[counter, counter_2, counter_3, counter_4])  # disabled
button = Button()
panel = Panel("0.05")
panel_2 = Panel("9")
counter = PersistentPythonDataCounter(reset=button, incr="2.5", modVal="360")  # -> out, i; inputs reset: Boolean, incr: Double, modVal: Double
# ---------- counter: Python ----------
ghenv.Component.Name = 'Persistent Python Data Counter'
ghenv.Component.NickName = 'Counter'
ghenv.Component.Message = ''
ghenv.Component.Category = 'Demo'
ghenv.Component.SubCategory = ''

# Use a global dictionary to store counter values
if "counter_data" not in globals():
    counter_data = {}

# Unique key for this instance
unique_counter_key = str(ghenv.Component.InstanceGuid)

# Get previous counter value, default to 0
i = counter_data.get(unique_counter_key, -incr)

# Reset condition: Set i to 0
if reset:
    i = 0
# Stop counting if max value is reached
elif modVal is not None and i >= modVal:
    pass  # Do nothing, stop updating 'i'
# Increment normally
else:
    i += incr  

# Update Grasshopper UI message
ghenv.Component.Message = str(i)

# Store the updated value in the global dictionary
counter_data[unique_counter_key] = i
# ---------- end counter ----------
counter_2 = PersistentPythonDataCounter(reset=button, incr="5", modVal="360")  # -> out, i; inputs reset: Boolean, incr: Double, modVal: Double; same code as counter
crv = Curve(<curve referenced from the Rhino model>)
crv_2 = Curve(<curve referenced from the Rhino model>)
crv_3 = Curve(<curve referenced from the Rhino model>)
crv_4 = Curve(<curve referenced from the Rhino model>)
crv_5 = Curve(<curve referenced from the Rhino model>)
crv_6 = Curve([<curve referenced from the Rhino model> x20])
crv_7 = Curve([<curve referenced from the Rhino model> x55])

# ----
# Scripts
panel_3 = Panel("smooth_turn_waypoints.py")

pt = Point(Point(-203.6103915, 113.1807425, 0))
midpt = CurveMiddle(Curve=crv_4)
midpt_2 = CurveMiddle(Curve=crv_5)
midpt_3 = CurveMiddle(Curve=crv)
midpt_4 = CurveMiddle(Curve=crv_2)
midpt_5 = CurveMiddle(Curve=crv_3)
counter_3 = PersistentPythonDataCounter(reset=button, incr="0.1", modVal="2")  # -> out, i; inputs reset: Boolean, incr: Double, modVal: Double; same code as counter
counter_4 = PersistentPythonDataCounter(reset=button, incr="0.1", modVal="5")  # -> out, i; inputs reset: Boolean, incr: Double, modVal: Double; same code as counter
rotate = Rotate(Geometry=crv_5, Angle=expr("-x", degrees(counter_2.i)), Plane=pt)  # -> Geometry, Transform
rotate_2 = Rotate(Geometry=crv_5, Angle=expr("-x", degrees(counter_2.i)), Plane=midpt_2)  # -> Geometry, Transform
rotate_3 = Rotate(Geometry=crv, Angle=expr("-x", degrees(counter_2.i)), Plane=midpt_3)  # -> Geometry, Transform
rotate_4 = Rotate(Geometry=crv_2, Angle=expr("-x", degrees(counter_2.i)), Plane=midpt_4)  # -> Geometry, Transform
rotate_5 = Rotate(Geometry=crv_7, Angle=degrees(counter.i), Plane=pt)  # -> Geometry, Transform

# ---- group: script directory
S = Script(modules=panel_3)  # -> script_dirs, patterns; inputs modules: list
# ---------- S: Python ----------
import sys
import os
import Grasshopper


# 1. Get the current Grasshopper file location
# This accesses the document that owns this component
gh_doc = ghenv.Component.OnPingDocument()

if gh_doc.FilePath:
    gh_file_path = gh_doc.FilePath
    gh_dir = os.path.dirname(gh_file_path)      # ...\src\gh
    project_root = os.path.dirname(gh_dir)      
    
    script_dirs = []
    patterns = [i for i in range(len(modules))]
    
    
    for module in modules:
        script_dir = os.path.normpath(os.path.join(project_root, "script", module))
        script_dirs.append(script_dir)

        if script_dir not in sys.path:
            sys.path.append(script_dir)
# ---------- end S ----------

# ----
rotate_6 = Rotate(Geometry=crv_3, Angle=degrees(counter.i), Plane=midpt_5)  # -> Geometry, Transform
len = Length(Curve=rotate_5.Geometry)
merge = Merge(
    Data1=rotate_5.Geometry,
    Data2=rotate_2.Geometry,
    Data3=rotate_3.Geometry,
    Data4=rotate_4.Geometry,
    Data5=rotate_6.Geometry)
divide = DivideCurve(Curve=rotate_5.Geometry, Count=expr("x/1", len), Kinks=False)  # -> Points, Tangents, Parameters
points = Data(divide.Points)
smooth_turn_waypoints = MyPythonEditer(
    script=S.script_dirs,
    points_list=points,
    theta_max_deg=Slider(45, range=10..60),
    step_len=Slider(0, range=0..5),
    extend_len=Slider(5, range=0..5))  # -> out, all_way_points, all_end_points; inputs points_list: tree of Point3d, theta_max_deg: Double, step_len: Double, extend_len: Double
#   port script: Script to execute
# ---------- smooth_turn_waypoints: Python ----------
__author__ = "Yen-Fen Chan"
__version__ = "0.1.0"
__date__ = '2024.00.00'
__updated__ = '2025.00.00'

import Rhino.Geometry as rg
import ghpythonlib.treehelpers as th
import math


# ── vector helpers ──────────────────────────────────────────────────────────

def unit_vec(v):
    """Return a unitized copy of v. Returns zero vector if input is zero."""
    v = rg.Vector3d(v)
    if v.IsZero:
        return v
    v.Unitize()
    return v


def angle_between(u, v):
    """
    Signed angle (radians) from u to v in the XY plane.
    Positive = counter-clockwise.
    """
    u = unit_vec(u)
    v = unit_vec(v)
    d = max(-1.0, min(1.0, rg.Vector3d.Multiply(u, v)))
    z = rg.Vector3d.CrossProduct(u, v).Z
    ang = math.acos(d)
    return ang if z >= 0 else -ang


# ── turn waypoint builder ────────────────────────────────────────────────────

def build_turn_vias(E, a_vec, S, b_vec,
                    theta_max_deg=30.0,
                    step_len=5.0,
                    extend_len=0.0):
    """
    Build polygonal turn waypoints between path end E and next path start S.

    Strategy:
      1. Estimate space needed for the turn.
      2. If space is insufficient or turn is near 180°, fall back to
         extend-only mode: push one exit point forward from E and one
         entry point backward from S, each using at most 40% of available
         distance. This avoids crossing or jagged paths.
      3. Otherwise, build a proper angle-capped polygonal turn with an
         optional forward offset (extend_len) before the first step.

    Parameters
    ----------
    E            : rg.Point3d  — end of current path
    a_vec        : vector      — current heading at E
    S            : rg.Point3d  — start of next path
    b_vec        : vector      — desired heading into S
    theta_max_deg: max turn angle per step (degrees)
    step_len     : arc step length
    extend_len   : forward offset before starting the turn

    Returns
    -------
    exit_pts  : list[rg.Point3d]  — waypoints leaving E
    entry_pts : list[rg.Point3d]  — waypoints arriving at S
    """
    a_h = unit_vec(a_vec)
    b_h = unit_vec(b_vec)

    beta     = angle_between(a_h, b_h)
    beta_abs = abs(beta)

    # Number of rotation steps needed
    theta_rad = math.radians(theta_max_deg) if theta_max_deg > 1e-6 else math.radians(1.0)
    k_steps = int(math.ceil(beta_abs / theta_rad)) if beta_abs > 1e-6 else 0

    # Space required vs available
    needed    = extend_len + k_steps * step_len
    available = E.DistanceTo(S)

    # ── Insufficient space: just extend forward from both ends ────────────
    if needed > available:
        b_h       = unit_vec(b_vec)
        exit_pts  = [rg.Point3d(E + a_h * extend_len)]
        entry_pts = [rg.Point3d(S + b_h * extend_len)]
        return exit_pts, entry_pts

    # ── Normal polygonal turn ──────────────────────────────────────────────
    exit_pts = []

    # Straight ahead — no rotation needed
    if k_steps == 0:
        return exit_pts, []

    # Optional forward offset before turning
    if extend_len > 0.0:
        P_start = rg.Point3d(E + a_h * extend_len)
        exit_pts.append(P_start)
        E = P_start

    # Rotate heading step by step
    dtheta = beta / k_steps
    cur_pt = rg.Point3d(E)
    cur_h  = rg.Vector3d(a_h)

    for _ in range(k_steps - 1):
        cs = math.cos(dtheta)
        sn = math.sin(dtheta)
        cur_h  = rg.Vector3d(cur_h.X * cs - cur_h.Y * sn,
                             cur_h.X * sn + cur_h.Y * cs,
                             0.0)
        cur_pt = rg.Point3d(cur_pt + unit_vec(cur_h) * step_len)
        exit_pts.append(cur_pt)

    return exit_pts, []          # entry_pts handled symmetrically in main


# ── helpers ──────────────────────────────────────────────────────────────────

def dedup_chain(pts, min_dist):
    """Remove consecutive points that are closer than min_dist."""
    out = []
    for p in pts:
        if not out or out[-1].DistanceTo(p) >= min_dist:
            out.append(p)
    return out


# ── main ─────────────────────────────────────────────────────────────────────

points_list = th.tree_to_list(points_list)

all_curves        = []
all_travel_points = []

for i, pts in enumerate(points_list or []):
    if not pts or len(pts) < 2:
        continue

    # Keep the original stroke polyline
    all_curves.append(rg.PolylineCurve(rg.Polyline(pts)))

    # Build travel segment to the next stroke
    if i >= len(points_list) - 1:
        continue

    nxt = points_list[i + 1]
    if not nxt or len(nxt) < 1:
        continue

    E      = pts[-1]
    E_prev = pts[-2]
    S      = nxt[0]

    a_vec       = E - E_prev   # heading leaving E
    b_vec_entry = nxt[1] - nxt[0] if len(nxt) >= 2 else S - E  # entry uses next stroke direction

    # ── Exit waypoints (leaving current stroke) — extend only ────────────
    a_h      = unit_vec(a_vec)
    exit_pts = [rg.Point3d(E + a_h * extend_len)]

    # ── Entry waypoints (approaching next stroke, computed in reverse) ────
    entry_pts = []
    if len(nxt) >= 2:
        E2      = nxt[0]
        E2_prev = nxt[1]
        S2      = pts[-1]

        a_vec2 = E2 - E2_prev    # heading into nxt[0] (reverse direction)
        b_vec2 = S2 - E2         # desired heading toward current end

        entry_rev, _ = build_turn_vias(
            E2, a_vec2, S2, b_vec2,
            theta_max_deg, step_len, extend_len
        )
        entry_pts = list(reversed(entry_rev))

    # ── Merge and deduplicate ─────────────────────────────────────────────
    travel_pts = exit_pts + entry_pts
    travel_pts = dedup_chain(travel_pts, step_len * 0.25)

    all_travel_points.append(travel_pts)

    if travel_pts:
        all_curves.append(rg.PolylineCurve(rg.Polyline(travel_pts)))

all_way_points = th.list_to_tree(all_travel_points)
# ---------- end smooth_turn_waypoints ----------
order = PointOrder(Points=flatten(divide.Points))
number_slider = Slider(0.1, range=0..1)
number_slider_2 = Slider(1, range=0..1)
pt_2 = Point(smooth_turn_waypoints.all_way_points)
pt_3 = Point(smooth_turn_waypoints.all_end_points)
item = ListItem(List=pt_3, Index=0, Wrap=True)  # -> Item1, Item
series = Series(Start=Slider(1, range=0..1), Step=Slider(0.03, range=0..0.1), Count="24")  # -> graft(Series)
swatch = ColourSwatch(SwatchColor=RGB(143, 143, 143))
number_slider_3 = Slider(2.9, range=0..10)
merge_2 = Merge(Data1=item.Item, Data2=pt_2, Data3=item.Item1)
pt_4 = Point(merge_2)
crv_8 = Curve(rotate_5.Geometry)
swatch_2 = ColourSwatch(SwatchColor=RGB(0, 0, 0))
pointdis = PointDisplay(Point=divide.Points, Color=swatch_2, Radius=Slider(1.7, range=0..10), Type=4)
pline = PolyLine(Vertices=pt_4, Closed=False)
crv_9 = Curve(pline)
previewlw = CustomPreviewLineweights(Geometry=crv_9, Shader=ColourSwatch(SwatchColor=RGB(0, 204, 255)), Thickness=series, Absolute=False)
previewlw_2 = CustomPreviewLineweights(Geometry=crv_8, Shader=swatch_2, Thickness=Slider(1, range=0..10), Absolute=False)
move = Move(Geometry=pt_4, Motion="{0,1.3,0}")  # -> Geometry, Transform
pointdis_2 = PointDisplay(Point=pt_4, Color=ColourSwatch(SwatchColor=RGB(0, 155, 194)), Radius=Slider(2.9, range=0..10), Type=4)
points_2 = PointList(Points=move.Geometry, Size=Slider(0.8, range=0..1))
